# Dynamo graph ESSBuilder_02_띠장.dyn (Dynamo 2.12.0.5650)

h파일_선택 = DSModelElementsSelection()  # 1434 picked in the model; graph input
code_block = CodeBlock { "H파일번호"; }
getParameterValueByName = Element.GetParameterValueByName(element=h파일_선택, parameterName=code_block)
string = StringInput("")
eq = getParameterValueByName == string
filterByBoolMask = List.FilterByBoolMask(list=h파일_선택, mask=eq)
code_block_2 = CodeBlock { "H파일번호"; }
getParameterValueByName_2 = Element.GetParameterValueByName(element=filterByBoolMask.out, parameterName=code_block_2)
sortByKey = List.SortByKey(list=filterByBoolMask.out, keys=getParameterValueByName_2)
getLocation = Element.GetLocation(element=sortByKey.sortedList)
startPoint = Curve.StartPoint(curve=getLocation)
X = Point.X(point=startPoint)
Y = Point.Y(point=startPoint)
byCoordinates = Point.ByCoordinates(x=X, y=Y)
lastItem = List.LastItem(list=byCoordinates)
indexOf = List.IndexOf(list=byCoordinates, element=lastItem)
code_block_3 = CodeBlock(x=indexOf) { 0..(x-2); 1..(x-1); 2..x; 0..(x-1); 1..x; }
pn_1 = List.GetItemAtIndex(list=byCoordinates, index=code_block_3.out1)
pn_2 = List.GetItemAtIndex(list=byCoordinates, index=code_block_3.out0)
pn_1pn_2 = Vector.ByTwoPoints(start=pn_1, end=pn_2)
pn = List.GetItemAtIndex(list=byCoordinates, index=code_block_3.out2)
pn_1pn = Vector.ByTwoPoints(start=pn_1, end=pn)
angleWithVector = Vector.AngleWithVector(vector=pn_1pn_2, otherVector=pn_1pn)
round = Math.Round(number=angleWithVector)
add = Vector.Add(vector=pn_1pn_2, vectorToAdd=pn_1pn)
reverse = Vector.Reverse(vector=add)
ZAxis = Vector.ZAxis()
code_block_4 = CodeBlock { 90; }
rotate = Vector.Rotate(vector=pn_1pn, axis=ZAxis, degrees=code_block_4)
cross = Vector.Cross(vector=pn_1pn_2, cross=pn_1pn)
Z = Vector.Z(vector=cross)
python_script = Python(IN[0]=round, IN[1]=reverse, IN[2]=rotate, IN[3]=Z)  # IronPython2
# ---------- python_script.python (32 lines) ----------
# Python 표준 및 DesignScript 라이브러리 로드
import sys
import clr
clr.AddReference('ProtoGeometry')
from Autodesk.DesignScript.Geometry import *

def IsCorner(deg):
	if(deg != 180):
		return False
	else:
		return True
# 이 노드에 대한 입력값은 IN 변수에 리스트로 저장됩니다.
dataEnteringNode = IN

# 코드를 이 선 아래에 배치
degs = IN[0]
AddedVec = IN[1]
RotatedVec = IN[2]
CrossResult = IN[3]
ConvertedVecs = [];
for i in range (0, degs.Count):
	if(IsCorner(degs[i])):
		ConvertedVecs.append(RotatedVec[i])
	else:
		if(CrossResult[i] > 0):
			ConvertedVecs.append(AddedVec[i])
		else:
			ConvertedVecs.append(Vector.Reverse(AddedVec[i]))
			
	
# 출력을 OUT 변수에 지정합니다.
OUT = ConvertedVecs
# ----------------------------------------
lastItem_2 = List.LastItem(list=python_script)
firstItem = List.FirstItem(list=python_script)
addItemToFront = List.AddItemToFront(item=firstItem, list=python_script)
addItemToEnd = List.AddItemToEnd(item=lastItem_2, list=addItemToFront)
normalized = Vector.Normalized(vector=addItemToEnd)
띠장_생성위치_전환 = BoolSelector(false)  # graph input
python_script_2 = Python(IN[0]=띠장_생성위치_전환)  # IronPython2
# ---------- python_script_2.python (16 lines) ----------
# Python 표준 및 DesignScript 라이브러리 로드
import sys
import clr
clr.AddReference('ProtoGeometry')
from Autodesk.DesignScript.Geometry import *

# 이 노드에 대한 입력값은 IN 변수에 리스트로 저장됩니다.
dataEnteringNode = IN

# 코드를 이 선 아래에 배치

# 출력을 OUT 변수에 지정합니다.
if(IN[0] == True):
	OUT = 1
else:
	OUT = -1
# ----------------------------------------
h파일_토류판_h값 = StructuralColumnTypes("D550_H파일")  # graph input
code_block_5 = CodeBlock { "h"; }
hp = Python(IN[0]=h파일_토류판_h값, IN[1]=code_block_5)  # IronPython2
# ---------- hp.python (40 lines) ----------
# Python 표준 및 DesignScript 라이브러리 로드
import clr
import sys
sys.path.append('C:\Program Files (x86)\IronPython 2.7\Lib')
import System
from System import Array
from System.Collections.Generic import *
clr.AddReference('ProtoGeometry')
from Autodesk.DesignScript.Geometry import *
clr.AddReference("RevitNodes")
import Revit
clr.ImportExtensions(Revit.Elements)
clr.ImportExtensions(Revit.GeometryConversion)
clr.AddReference("RevitServices")
import RevitServices
from RevitServices.Persistence import DocumentManager 
from RevitServices.Transactions import TransactionManager 

clr.AddReference("RevitAPI")
clr.AddReference("RevitAPIUI")

import Autodesk 
from Autodesk.Revit.DB import *
from Autodesk.Revit.UI import *

doc = DocumentManager.Instance.CurrentDBDocument
uiapp = DocumentManager.Instance.CurrentUIApplication 
app = uiapp.Application 
uidoc = uiapp.ActiveUIDocument

#######OK NOW YOU CAN CODE########

# 이 노드에 대한 입력값은 IN 변수에 리스트로 저장됩니다.
dataEnteringNode = IN
WallType = IN[0]
ParameterName = IN[1]
WAL_Param = WallType.GetParameterValueByName(ParameterName)
# 코드를 이 선 아래에 배치
# 출력을 OUT 변수에 지정합니다.
OUT = WAL_Param
# ----------------------------------------
띠장_h값 = StructuralFramingTypes("띠장 스트러트_300X300")
code_block_6 = CodeBlock { "d"; }
hw = Python(IN[0]=띠장_h값, IN[1]=code_block_6)  # IronPython2
# ---------- hw.python (41 lines) ----------
# Python 표준 및 DesignScript 라이브러리 로드
import clr
import sys
sys.path.append('C:\Program Files (x86)\IronPython 2.7\Lib')
import System
from System import Array
from System.Collections.Generic import *
clr.AddReference('ProtoGeometry')
from Autodesk.DesignScript.Geometry import *
clr.AddReference("RevitNodes")
import Revit
clr.ImportExtensions(Revit.Elements)
clr.ImportExtensions(Revit.GeometryConversion)
clr.AddReference("RevitServices")
import RevitServices
from RevitServices.Persistence import DocumentManager 
from RevitServices.Transactions import TransactionManager 

clr.AddReference("RevitAPI")
clr.AddReference("RevitAPIUI")

import Autodesk 
from Autodesk.Revit.DB import *
from Autodesk.Revit.UI import *

doc = DocumentManager.Instance.CurrentDBDocument
uiapp = DocumentManager.Instance.CurrentUIApplication 
app = uiapp.Application 
uidoc = uiapp.ActiveUIDocument

#######OK NOW YOU CAN CODE########

# 이 노드에 대한 입력값은 IN 변수에 리스트로 저장됩니다.
dataEnteringNode = IN
ColType = IN[0]
ParameterName = IN[1]
tF = ColType.GetParameterValueByName(ParameterName)
#Col_Sym = 
# 코드를 이 선 아래에 배치
# 출력을 OUT 변수에 지정합니다.
OUT = tF
# ----------------------------------------
code_block_7 = CodeBlock(Wdirection=python_script_2, Hp=hp, Hw=hw) { Wdirection*Math.Abs(0.5*(Hp + Hw)); }
offset수동입력 = BoolSelector(true)  # graph input
number = DoubleInput(550)  # graph input
python_script_3 = Python(IN[0]=code_block_7, IN[1]=offset수동입력, IN[2]=number, IN[3]=python_script_2)  # IronPython2
# ---------- python_script_3.python (17 lines) ----------
# Python 표준 및 DesignScript 라이브러리 로드
import sys
import clr
clr.AddReference('ProtoGeometry')
from Autodesk.DesignScript.Geometry import *

# 이 노드에 대한 입력값은 IN 변수에 리스트로 저장됩니다.
dataEnteringNode = IN

# 코드를 이 선 아래에 배치
if(IN[1] == True):
	OUT = IN[2]*IN[3]
else:
	OUT = IN[0]*IN[3]


# 출력을 OUT 변수에 지정합니다.
# ----------------------------------------
scale = Vector.Scale(vector=normalized, scale_factor=python_script_3)
translate = Geometry.Translate(geometry=byCoordinates, direction=scale)
wale_table = Filename("..\..\..\..\..\..\..\..\Users\Jake\OneDrive\JAKK3 Lab\01_BIM\01_Project\22-08. 무안오룡2차\기타지원\230502_토목 수정\01_RVT\Table\Wales_43BL.xlsx")  # graph input
file_from_path = FileObject(path=wale_table)
시트이름 = StringInput("Wale")  # graph input
boolean = BoolSelector(false)
importExcel = Data.ImportExcel(file=file_from_path, sheetName=시트이름, showExcel=boolean)
identity = Object.Identity(object=importExcel)
code_block_8 = CodeBlock { 1; }
dropItems = List.DropItems(list=identity, amount=code_block_8)
transpose = List.Transpose(lists=dropItems)
code_block_9 = CodeBlock { 2; 3; 4; }
wale_Start = List.GetItemAtIndex(list=transpose, index=code_block_9.out0)
code_block_10 = CodeBlock(x=wale_Start) { x-1; }
pt_WaleStart = List.GetItemAtIndex(list=translate, index=code_block_10)
X_2 = Point.X(point=pt_WaleStart)
Y_2 = Point.Y(point=pt_WaleStart)
wale_Level = List.GetItemAtIndex(list=transpose, index=code_block_9.out2)
byCoordinates_2 = Point.ByCoordinates(x=X_2, y=Y_2, z=wale_Level)
wale_End = List.GetItemAtIndex(list=transpose, index=code_block_9.out1)
code_block_11 = CodeBlock(x=wale_End) { x-1; }
pt_WaleEnd = List.GetItemAtIndex(list=translate, index=code_block_11)
X_3 = Point.X(point=pt_WaleEnd)
Y_3 = Point.Y(point=pt_WaleEnd)
byCoordinates_3 = Point.ByCoordinates(x=X_3, y=Y_3, z=wale_Level)
byStartPointEndPoint = Line.ByStartPointEndPoint(startPoint=byCoordinates_2, endPoint=byCoordinates_3)
기준레벨_el_0 = Levels("EL+0")  # graph input
띠장종류 = StructuralFramingTypes("띠장 스트러트_300X300")  # graph input
braceByCurve = StructuralFraming.BraceByCurve(curve=byStartPointEndPoint, level=기준레벨_el_0, structuralFramingType=띠장종류)
code_block_12 = CodeBlock { "횡단면 회전"; 90; }
setParameterByName = Element.SetParameterByName(element=braceByCurve, parameterName=code_block_12.out0, value=code_block_12.out1)
end = Revit.Transaction.Transaction.End(input=setParameterByName)
